# Dynamo graph ChangeSysPath.dyn (Dynamo 2.3.0.5885)

string = StringInput("ChangeSysPath.py")  # graph input
file_from_path = FileObject(path=string)
readText = FileSystem.ReadText(file=file_from_path)
reload = BoolSelector(false)
calculate_all = BoolSelector(true)
python_script_from_string = PythonStringNode(script=readText, IN[0]=file_from_path, IN[1]=reload, IN[2]=calculate_all)
